% Simulink data dictionary AUV_Params.sldd

x_rg = Simulink.Parameter(0)
y_rg = Simulink.Parameter(0)
z_rg = Simulink.Parameter(0)
x_rb = Simulink.Parameter(0)
y_rb = Simulink.Parameter(0)
z_rb = Simulink.Parameter(0)
I_x = Simulink.Parameter(0.538)
I_y = Simulink.Parameter(0.5057)
I_z = Simulink.Parameter(0.5432)
water_density = Simulink.Parameter(1000)
radius = Simulink.Parameter(0.26)
m = Simulink.Parameter(23.9)
g = Simulink.Parameter(9.81)
W = Simulink.Parameter(234.459)
B = Simulink.Parameter(-234.459)
lx1 = Simulink.Parameter(0.0194)
ly1 = Simulink.Parameter(0.0381)
lz1 = Simulink.Parameter(0.0575)
lx2 = Simulink.Parameter(0.0194)
ly2 = Simulink.Parameter(-0.0381)
lz2 = Simulink.Parameter(0.0575)
lx3 = Simulink.Parameter(-0.0317)
ly3 = Simulink.Parameter(0.0049)
lz3 = Simulink.Parameter(0.0366)
lx4 = Simulink.Parameter(-0.0317)
ly4 = Simulink.Parameter(-0.0049)
lz4 = Simulink.Parameter(0.0366)
lx5 = Simulink.Parameter(0.0317)
ly5 = Simulink.Parameter(0.0049)
lz5 = Simulink.Parameter(0.0366)
lx6 = Simulink.Parameter(0.0317)
ly6 = Simulink.Parameter(-0.0049)
lz6 = Simulink.Parameter(0.0366)
lx7 = Simulink.Parameter(-0.0194)
ly7 = Simulink.Parameter(0.0381)
lz7 = Simulink.Parameter(0.0575)
lx8 = Simulink.Parameter(-0.0194)
ly8 = Simulink.Parameter(-0.0381)
lz8 = Simulink.Parameter(0.0575)
force = Simulink.Parameter(20)
Fx1 = Simulink.Parameter(-14.142)
Fy1 = Simulink.Parameter(14.142)
Fz1 = Simulink.Parameter(0)
Fx2 = Simulink.Parameter(-14.142)
Fy2 = Simulink.Parameter(-14.142)
Fz2 = Simulink.Parameter(0)
Fx3 = Simulink.Parameter(0)
Fy3 = Simulink.Parameter(0)
Fz3 = Simulink.Parameter(-20)
Fx4 = Simulink.Parameter(0)
Fy4 = Simulink.Parameter(0)
Fz4 = Simulink.Parameter(-20)
Fx5 = Simulink.Parameter(0)
Fy5 = Simulink.Parameter(0)
Fz5 = Simulink.Parameter(-20)
Fx6 = Simulink.Parameter(0)
Fy6 = Simulink.Parameter(0)
Fz6 = Simulink.Parameter(-20)
Fx7 = Simulink.Parameter(14.142)
Fy7 = Simulink.Parameter(14.142)
Fz7 = Simulink.Parameter(0)
Fx8 = Simulink.Parameter(14.142)
Fy8 = Simulink.Parameter(-14.142)
Fz8 = Simulink.Parameter(0)